# Grasshopper definition 210819_HopsLauncher_GrasshopperDevelopment.gh (Grasshopper 1.0.7)
# plug-ins: Weaverbird, Hops, CockroachGH

mesh = Mesh(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)
cloud = PointCloud(<pointcloud referenced from the Rhino model>)
pipeline = GeometryPipeline(
    GroupByLayer=False,
    GroupByType=False,
    IncludeHidden=True,
    IncludeLocked=True,
    LayerFilter="BoxCrop",
    NameFilter="*",
    SublayerFiltering=True,
    TypeFilter=1073741848)
wbsplitquads = WeaverbirdsConstantQuadsSplitSubdivision(MeshCurves=mesh, Level=1, SmoothNakedEdges=1)
downsample = Downsample(PointCloud=cloud, N=Slider(500000, range=-1000000..1000000))
Y = UnitY(Factor=Slider(13, range=0..100))
cloudboxcrop = CloudBoxCrop(PointCloud=downsample, Boxes=pipeline, Inverse=False)
mesh_2 = Mesh(mesh)
demesh = DeconstructMesh(Mesh=wbsplitquads)  # -> Vertices, Faces, Colours, Normals
crv = Curve(<curve referenced from the Rhino model>)
number_slider = Slider(352, range=0..360)
cloud_2 = PointCloud(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)

# ---- group: sample a rotation vector
cluster = Cluster()

# ----
Y_2 = UnitY(Factor=Slider(31, range=0..100))
divide = DivideCurve(Curve=crv, Count=Slider(55, range=0..100), Kinks=False)  # -> Points, Tangents, Parameters
pt = Point(demesh.Vertices)
pt_2 = Point(pt)
move = Move(Geometry=pt_2, Motion=Y)  # -> Geometry, Transform
avr = Average(Input=move.Geometry)
downsample_2 = Downsample(PointCloud=cloud_2, N=Slider(50000, range=-1000000..1000000))
move_2 = Move(Geometry=mesh_2, Motion=Y)  # -> Geometry, Transform
vec = Vector(cluster)
move_3 = Move(Geometry=divide.Points, Motion=Y_2)  # -> Geometry, Transform
explode = CloudExplode(PointCloud=downsample_2)  # -> Points, Normals, Colors
avr_2 = Average(Input=move_3.Geometry)
rot3d = Rotate3D(Geometry=move.Geometry, Angle=degrees(number_slider), Center=avr, Axis=vec)  # -> Geometry, Transform
rot3d_2 = Rotate3D(Geometry=move_2.Geometry, Angle=degrees(number_slider), Center=avr, Axis=vec)  # -> Geometry, Transform
nearest_neighnor_algorithm = ValueList({"KNN": 0, "Hungarian": 1}, selected="KNN")
nearest_neighnor_algorithm_2 = ValueList({"KNN": 0, "Hungarian": 1}, selected="KNN")
hops = Hops(
    Points=demesh.Vertices,
    CacheResultsInMemory=False,
    CacheSolveResults=False,
    RemoteDefinitionLocation="http://127.0.0.1:5000/open3d.PoissonMesh",
    RemoteSolveVersion=(0, 1, 0),
    ShowInput_Enabled=False,
    ShowInput_Path=False,
    SynchronousSolve=False)
rot3d_3 = Rotate3D(Geometry=move_3.Geometry, Angle=degrees(Slider(119, range=0..360)), Center=avr_2, Axis=vec)  # -> Geometry, Transform
demesh_2 = DeconstructMesh(Mesh=rot3d_2.Geometry)  # -> Vertices, Faces, Colours, Normals
culln = CullNth(List=rot3d_3.Geometry, CullFrequency=2)
hops_2 = Hops(
    ScenePoints=demesh_2.Vertices,
    ModelPoints=pt,
    Threshold="1e-3",
    MaxIterations=Slider(20, range=0..100),
    NNAlgorithm=nearest_neighnor_algorithm_2,
    CacheResultsInMemory=False,
    CacheSolveResults=False,
    RemoteDefinitionLocation="http://127.0.0.1:5000/icp.RegisterPointClouds",
    RemoteSolveVersion=(0, 1, 0),
    ShowInput_Enabled=False,
    ShowInput_Path=False,
    SynchronousSolve=False)  # -> RegisteredPoints, Transform, Error, Iterations
hops_3 = Hops(
    ScenePoints=culln,
    ModelPoints=divide.Points,
    Threshold="1e-3",
    MaxIterations=Slider(45, range=0..100),
    NNAlgorithm=nearest_neighnor_algorithm,
    CacheResultsInMemory=False,
    CacheSolveResults=False,
    RemoteDefinitionLocation="http://127.0.0.1:5000/icp.RegisterPointClouds",
    RemoteSolveVersion=(0, 1, 0),
    ShowInput_Enabled=False,
    ShowInput_Path=False,
    SynchronousSolve=False)  # -> RegisteredPoints, Transform, Error, Iterations
matrix = ConstructMatrix(Rows=4, Columns=4, Values=hops_2.Transform)
matrix_2 = TransformMatrix(matrix, Digits=3)
panel = Panel(hops_2.Error)
panel_2 = Panel(hops_2.Iterations)
registeredpoints = Point(hops_2.RegisteredPoints)
preview = CustomPreview(Geometry=mesh, Material=ColourSwatch(SwatchColor=RGB(101, 255, 255)))
preview_2 = CustomPreview(
    Geometry=rot3d_2.Geometry,
    Material={diffuse=RGB(221, 160, 221), emission=RGB(66, 48, 66), shine=0.5, specular=RGB(255, 255, 255), transparency=0})
preview_3 = CustomPreview(Geometry=registeredpoints, Material=ColourSwatch(SwatchColor=RGB(255, 0, 255)))

# ==== cluster Cluster
center_box = CenterBox(Base=PlaneXY(0, 0, 0), X=1, Y=1, Z=1)
populate_3d = Populate3D(Region=center_box, Count=100, Seed=1)
point = Point("0,0,0")
jitter = Jitter(List=populate_3d, Jitter=1, Seed=Slider(17, range=2..100))  # -> Values, Indices
list_item = ListItem(List=jitter.Values, Index=0, Wrap=True)
vector_2pt = Vector2Pt(PointA=point, PointB=list_item, Unitize=False)  # -> unitize(Vector), Length
vector = ClusterOutput(vector_2pt.Vector)
